# Grasshopper definition CurveCompressor.gh (Grasshopper 1.0.7)

curve = Curve(<curve referenced from the Rhino model>)
surface = Surface(<surface referenced from the Rhino model>)
number = Number(1)
contractcurve = ContractCurve(surface=surface, curve=curve, inwards=number)

# ==== cluster ContractCurve
inwards = ClusterInput()
surface = ClusterInput()
curve = ClusterInput()
range = Range(Domain=Domain(0, 1), Steps=1000)
surface_2 = Surface(surface)
curve_2 = Curve(curve)
evaluate_curve = EvaluateCurve(Curve=reparameterize(curve_2), Parameter=range)  # -> Point, Tangent, Angle
surface_closest_point = SurfaceClosestPoint(Point=evaluate_curve.Point, Surface=surface_2)  # -> Point, UVPoint, Distance
evaluate_surface = EvaluateSurface(Surface=surface_2, Point=surface_closest_point.UVPoint)  # -> Point, Normal, UDirection, VDirection, Frame
script_1_tbd = GhPythonScript(x=evaluate_curve.Point, y=evaluate_curve.Tangent, z=evaluate_surface.Normal, inwards=inwards)  # -> out, shiftedPoints
# ---------- script_1_tbd: Python ----------
"""Provides a scripting component.
    Inputs:
        x: Points along Curve
        y: Vectors tangent to curve at each point
        z: Vectors normal to surface at each point
        inwards: 1 if you want to shift curve inwards, -1 if outwards
    Output:
        a: The a output variable"""

__author__ = "Shoon"
__version__ = "2020.11.04"

import rhinoscriptsyntax as rs

epsilon = 0.01


# Compute the cross product of the above two vectors at each point
crosses = inwards * rs.VectorCrossProduct(z,y)

# Displace points along said cross product by some distance
shiftedPoints = rs.VectorAdd(x,epsilon*crosses)

# Copy points up by epsilon and down by epsilon to form a ribbon


# Take the intersection of the ribbon with the surface and draw it
# ---------- end script_1_tbd ----------
surface_closest_point_2 = SurfaceClosestPoint(Point=script_1_tbd.shiftedPoints, Surface=surface_2)  # -> Point, UVPoint, Distance
boolean = Boolean(True)
curve_on_surface = CurveOnSurface(Surface=surface_2, UVCoordinates=surface_closest_point_2.UVPoint, Closed=boolean)  # -> Curve, Length, Domain
evaluate_surface_2 = EvaluateSurface(Surface=surface_2, Point=surface_closest_point_2.UVPoint)  # -> Point, Normal, UDirection, VDirection, Frame
