# Grasshopper definition Githopper Basic Commands.gh (Grasshopper 1.0.7)
# plug-ins: Githopper

boolean = Boolean(True)
panel = Panel("https://github.com/Shoooooon/RGLCurveMapping")
pull_from_repository = PullFromRepository(Manual_resolve=boolean, Pull=Button())
commit_list = CommitList(Check=Button())
git_path = GitPath(Path="SOMEFILEPATH\RGLCurveMapping", Set=Button())  # -> Report, Help
commit_changes = CommitChanges(Message="Initial test commit - uploading torus", Commit=Button())  # -> Report, Help
panel_2 = Panel(pull_from_repository)
clone_repository = CloneRepository(
    URL=panel,
    Location="SOME FILEPATH\Githopper Repos",
    User_name="YOUR GITHUB ACCOUNT USERNAME",
    User_email="YOUR EMAIL",
    MarshallingSignalParameter=Button())
panel_3 = Panel(commit_list)
push_to_repository = PushToRepository(Repository=panel, Push=Button())
panel_4 = Panel(push_to_repository)
