# Grasshopper definition S20.gh (Grasshopper 1.0.7)
# plug-ins: treesloth01, Pufferfish

wide = Slider(0.341, range=-10..10)
taper = Slider(0.047, range=-0.2..0.2)
genus_2_surface = Genus2Surface(
    wide=wide,
    long=Slider(2.895, range=0..5),
    round=Slider(4.141, range=0..10),
    thick=Slider(8.693, range=0..10),
    taper=taper)  # -> L, P, geo_2
num = Number(0.1)
construct_master_curve = ConstructMasterCurve(P=genus_2_surface.P, geo=genus_2_surface.geo_2, epsilon=num)  # -> geo_3, crv_10, crv_11, crv_12, crv_13
construct_domain = ConstructDomain(DomainStart=0, DomainEnd=1)
curve = Curve(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)
integer = Integer(8)
master_curve_raw = Curve(reparameterize(<curve referenced from the Rhino model>))
fit_curve_smooth = FitCurveSmooth(Curve=master_curve_raw, FitTolerance=0.001, AngleTolerance=1)
python = GhPythonScript()  # -> out, example
# ---------- python: Python ----------
__author__ = "will"
__version__ = "2021.04.03"

import rhinoscriptsyntax as rs

example = [((3,0),(1,0)),((~1,0),(~2,0)),((2,0),(1,1)),((~1,1),(~2,0)),((2,0),(~0,0)),((0,0),(~3,0))]
# ---------- end python ----------
master_curve_smooth = Curve(fit_curve_smooth)
# Here's a complicated, inefficient curve that can be used as input as we work on code to "flow" a curve to a geodesic (efficient representative).
crv = Curve(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)
num_2 = Number(500)
range = Range(Domain=construct_domain, Steps=integer)
panel = Panel(python.example)
cluster = Cluster(curve=crv, brep=genus_2_surface.geo_2, steps=num_2)
panel_2 = Panel(construct_master_curve.crv_12)
evaluate_curve = EvaluateCurve(Curve=reparameterize(curve), Parameter=range)  # -> Point, Tangent, Angle
crv_2 = Curve(cluster)
crv_3 = Curve(reparameterize(construct_master_curve.crv_13))
crv_4 = Curve(construct_master_curve.crv_11)
crv_5 = Curve(construct_master_curve.crv_12)
python_2 = GhPythonScript(Run=Toggle(True), file="FlipperToGH.py", curve="[1,0,1,0,1,1,0,1,1]")  # -> out, data
# ---------- python_2: Python ----------
__author__ = "will"
__version__ = "2021.03.16"

import rhinoscriptsyntax as rs
import subprocess
import os
triangulation = [(~1,~8,~0),(~7,3,8),(~2,~6,7),(~5,2,6),(~3,~4,5),(0,1,4)]

curve = curve.replace(',','').replace('[','').replace(']','')

if ghdoc.Path:
    direc = os.path.dirname(ghdoc.Path)

    
Path = os.path.join(direc, file)


args = [curve]
if Run:
    
    comm = subprocess.Popen(['python3', Path] + args, stdout=subprocess.PIPE)
    stdout = comm.communicate()
    
    stdout=stdout[0]
    
    if stdout[:9] == 'Traceback':
        print stdout
    else:
        data=eval(stdout)
    

    comm.stdout.close()
    comm.wait()
# ---------- end python_2 ----------
python_3 = GhPythonScript(
    Run=Toggle(True),
    file="FlipperToGH_v3.py",
    initial_curve="b",
    mapping_class="aBeFcdAE",
    iterations=Slider(3, range=0..5),
    x=Button(),
    user="will_win")  # -> out, curve, flipped, perm
# ---------- python_3: Python ----------
__author__ = "will"
__version__ = "2021.03.16"

import rhinoscriptsyntax as rs
import subprocess
import sys
triangulation = [(~1,~8,~0),(~7,3,8),(~2,~6,7),(~5,2,6),(~3,~4,5),(0,1,4)]

import os

if ghdoc.Path:
    direc = os.path.dirname(ghdoc.Path)

    
Path = os.path.join(direc, file)


iterations = str(int(iterations))

args = [str(initial_curve), str(mapping_class), iterations]

if Run:
    if user == 'will_win':
        comm = subprocess.Popen(['python', Path] + args, stdout=subprocess.PIPE)
    elif user == 'will_mac':
        comm = subprocess.Popen(['/usr/bin/python3', Path] + args, stdout=subprocess.PIPE)
    elif user == 'daniel':
        comm = subprocess.Popen(['python3', Path] + args, stdout=subprocess.PIPE)
    stdout = comm.communicate()
    
    stdout=stdout[0]
    
    
    if stdout[:9] == 'Traceback':
        print stdout
    else:
        data=eval(stdout)
    

    comm.stdout.close()
    comm.wait()


    
curve=data[0]
flipped = data[1]
perm = data[2]
# ---------- end python_3 ----------
panel_3 = Panel(python_2.data)
panel_4 = Panel(python_2.out)
stack = StackTrees(Data0=crv_5, Data1=crv_4, Reduce=True)  # -> flatten(Tree)
panel_5 = Panel(python_3.out)
abstract_points_to_rhino3dpoints = GhPythonScript(mapCurveList=stack, abstractPointsList=python_3.curve)  # -> out, pairedPushPoints3D, GH_pairedPushPoints3D; inputs mapCurveList: list, abstractPointsList: list
# ---------- abstract_points_to_rhino3dpoints: Python ----------
"""Provides a scripting component.
    Inputs:
        mapCurveList: An ordered list of rhino curves
        abstractPointsList: A list of numbered intersections with each map edge, 
            as processed by flipper
    Output:
        pairedPushPoints3D: A list of pairs of 3d points corresponding to the 
            intersection points indicated in the abstractPointsList"""

__author__ = "Shoon"
__version__ = "2021.03.26"

import rhinoscriptsyntax as rs

# Count the number of intersection points on each edge.
# This will tell us how we should space them out.
pointsPerEdge = {}

for pair in abstractPointsList:
    for intersection in pair:
        if (intersection[0] not in pointsPerEdge.keys()):
            pointsPerEdge[intersection[0]] = 1
        else:
            pointsPerEdge[intersection[0]] += 1

# Place the points on each curve, limited to the parameter range [0.1, 0.9].
# Staying away from where we meet the puncture curves is a little safer.
pairedPushPoints3D = []
GH_pairedPushPoints3D = []

for pair in abstractPointsList:
    firstParam = (0.8 * (pair[0][1]/pointsPerEdge[pair[0][0]])) + 0.1
    first = rs.EvaluateCurve(mapCurveList[pair[0][0]], firstParam)
    secondParam = (0.8 * (pair[1][1]/pointsPerEdge[pair[1][0]])) + 0.1
    second = rs.EvaluateCurve(mapCurveList[pair[1][0]], secondParam)
    pairedPushPoints3D.append((first, second))
    GH_pairedPushPoints3D.append(first)
    GH_pairedPushPoints3D.append(second)
    
pairedPushPoints3D = pairedPushPoints3D
print(pairedPushPoints3D)
# ---------- end abstract_points_to_rhino3dpoints ----------
panel_6 = Panel(python_3.curve)
panel_7 = Panel(python_3.flipped)
panel_8 = Panel(python_3.perm)
eval = EvaluateCurve(Curve=construct_master_curve.crv_10, Parameter=graft(0))  # -> Point, Tangent, Angle
eval_2 = EvaluateCurve(Curve=crv_3, Parameter=graft([0, 1]))  # -> Point, Tangent, Angle
panel_9 = Panel(abstract_points_to_rhino3dpoints.pairedPushPoints3D)
panel_10 = Panel(abstract_points_to_rhino3dpoints.out)
pt = Point(abstract_points_to_rhino3dpoints.GH_pairedPushPoints3D)
sph = Sphere(Base=eval.Point, Radius=Slider(0.138, range=0..1))
number_slider = Slider(6, range=0..10)
sph_2 = Sphere(Base=eval_2.Point, Radius=Slider(0.102, range=0..1))
crv_6 = Curve(construct_master_curve.crv_10)
opacity = Slider(255, range=0..255)
color = Slider(0, range=0..19)
opacity_2 = Slider(255, range=0..255)
opacity_3 = Slider(255, range=0..255)
opacity_4 = Slider(177, range=0..255)
color_2 = Slider(8, range=0..19)
opacity_5 = Slider(255, range=0..255)
color_3 = Slider(3, range=0..19)
opacity_6 = Slider(255, range=0..255)
color_4 = Slider(2, range=0..19)
color_5 = Slider(6, range=0..19)
color_6 = Slider(4, range=0..19)
python_4 = GhPythonScript(
    points=abstract_points_to_rhino3dpoints.pairedPushPoints3D,
    master_curve=construct_master_curve.crv_10,
    epsilon=Slider(0.29, range=0..0.5),
    div_space=Slider(1, range=0..5),
    surface=construct_master_curve.geo_3,
    iterate_to_show=Slider(2, range=0..10),
    perm=python_3.perm,
    flipped=python_3.flipped)  # -> out, newcurves, main_curve, interp_pts, main_curves; inputs points: list, master_curve: Curve, surface: Brep, perm: list, flipped: list
# ---------- python_4: Python ----------
__author__ = "danielqiu"

"""
Input: t1: a list of 3D points that are the starting points of connections.
       t2: a list of 3D points that are the ending points of connections.
       main_curve
       surface
       eps
Output:
"""
import rhinoscriptsyntax as rs
import Rhino as rc
from System import Guid
import clr
import System

t1 = [p[0] for p in points]
t2 = [p[1] for p in points]
newcurves = []
main_curve = master_curve
main_curve.Domain = rc.Geometry.Interval(0,1)

interp_pts = []
main_curves = []

eps = epsilon
for i in range(len(t1)):
    main_curves.append(main_curve)
    t1paramnew = []
    t2paramnew = []
    t1param = main_curve.ClosestPoint(t1[i])[1]
    t2param = main_curve.ClosestPoint(t2[i])[1]
    print(t1param,t2param)
    print(main_curve.PointAt(t1param),main_curve.PointAt(t2param))
    #t1param = rs.CurveClosestPoint(main_curve, t1[i], segment_index=-1)
    #t2param = rs.CurveClosestPoint(main_curve, t2[i], segment_index=-1)
    if t1param > t2param:
        t1paramnew.append(t1param)
        t1paramnew.append(0)
        t2paramnew.append(1)
        t2paramnew.append(t2param)
    else:
        t1paramnew.append(t1param)
        t2paramnew.append(t2param)
    subcrvs = []
    for i in range(len(t1paramnew)):
        subcrv = main_curve.Trim(t1paramnew[i], t2paramnew[i])
        #subcrv = rs.AddSubCrv(main_curve, t1paramnew[i], t2paramnew[i])
        subcrvs.append(subcrv)
    if len(subcrvs) > 1:
        subcurve = rc.Geometry.Curve.JoinCurves(subcrvs)
        #subcurve = rs.JoinCurves(subcrvs)
        assert len(subcurve) == 1
        subcurve = subcurve[0]
    else:
        subcurve = subcrvs[0]
    #subcurve = rs.coercecurve(subcurve)
    subcurve.Domain=rc.Geometry.Interval(0,1)
    newpts = []
    """Need to specify num_of_seg"""
    length = rc.Geometry.Curve.GetLength(subcurve)
    #length = rs.CurveLength(subcurve)
    num_of_seg = int(length/div_space)
    divparams = subcurve.DivideByCount(num_of_seg,True)
    #divparams = rs.DivideCurve(subcurve, num_of_seg, create_points=False, return_points=False)

    for j in range(len(divparams)):
        divpt = subcurve.PointAt(divparams[j])

        #divpt = rs.EvaluateCurve(subcurve, divparams[j])
        
        cl_point_out = clr.StrongBox[rc.Geometry.Point3d]()
        ci_out = clr.StrongBox[rc.Geometry.ComponentIndex]()
        u_out = clr.StrongBox[System.Double]()
        v_out = clr.StrongBox[System.Double]()
        max_dist = 0
        normal = clr.StrongBox[rc.Geometry.Vector3d]()
        success = surface.ClosestPoint(divpt,cl_point_out, ci_out, u_out, v_out, max_dist, normal)
        normal = normal.Value
        
        #normal = rs.BrepClosestPoint(surface, divpt)[3]
        """Need to specify tangent"""
        tangent = subcurve.DerivativeAt(divparams[j],1)[1]
        #tangent = rs.CurveTangent(subcurve, divparams[j], segment_index=-1)
        pushoff = rc.Geometry.Vector3d.CrossProduct(tangent,normal)
        #pushoff = rs.VectorCrossProduct(tangent, normal)

        if j <= 20:
            dist = (eps*j)/20
        elif len(divparams)-j <= 20:
            dist = (eps*((len(divparams)-j-1)))/20
        else:
            dist = eps
        _ = pushoff.Unitize()
        #dist = eps * (len(divparams) / 2 - abs(len(divparams) / 2 - j - 1))
        pushoff_scaled = rc.Geometry.Vector3d.Multiply(pushoff,dist)

        newpt = rc.Geometry.Point3d.Add(divpt,pushoff_scaled)

        #newpt = rs.PointAdd(divpt, rs.VectorScale(pushoff, dist))
        if (j != 0) and (j!= len(divparams)-1):
            newpt = surface.ClosestPoint(newpt)
        
        #newpt = rs.BrepClosestPoint(surface, newpt)[0]
        newpts.append(newpt)

    interp_pts.append(newpts)
    newcrv = rc.Geometry.Curve.CreateInterpolatedCurve(newpts,3)
    #newcrv = rs.AddInterpCurve(newpts)
    newcurves.append(newcrv)
    t1paramnew = []
    t2paramnew = []
    if t1param < t2param:
        t1paramnew.append(t2param)
        t1paramnew.append(0)
        t2paramnew.append(1)
        t2paramnew.append(t1param)
    else:
        t1paramnew.append(t2param)
        t2paramnew.append(t1param)
    subcrvs = []
    for i in range(len(t1paramnew)):
        #print('y',main_curve.Domain)
        #print(main_curve.PointAt(0),main_curve.PointAt(1))
        subcrv = main_curve.Trim(t1paramnew[i], t2paramnew[i])
        #subcrv = rs.AddSubCrv(main_curve, t1paramnew[i], t2paramnew[i])
        subcrvs.append(subcrv)

    if len(subcrvs) > 1:
        subcurve2 = rc.Geometry.Curve.JoinCurves(subcrvs,.00000001,False)
        #subcurve2 = rs.JoinCurves(subcrvs)
        #print(subcrvs[0].PointAtNormalizedLength(0),subcrvs[0].PointAtNormalizedLength(1))
        #print(subcrvs[1].PointAtNormalizedLength(0),subcrvs[1].PointAtNormalizedLength(1))
        assert len(subcurve2) == 1
        subcurve2 = subcurve2[0]
    else:
        subcurve2 = subcrvs[0]

    newcrv.Domain = rc.Geometry.Interval(0,1)
    subcurve2.Domain = rc.Geometry.Interval(0,1)
    #print(main_curve.PointAt(0),main_curve.PointAt(t1param),main_curve.PointAt(t2param),main_curve.PointAt(1))
    #print(newcrv.PointAtNormalizedLength(0),newcrv.PointAtNormalizedLength(1))
    #print(subcurve2.PointAtNormalizedLength(0), subcurve2.PointAtNormalizedLength(1))
    main_curve = rc.Geometry.Curve.JoinCurves([newcrv,subcurve2],.0000001,False)

    #main_curve = rs.JoinCurves([newcrv, subcurve2])

    assert len(main_curve) == 1
    main_curve = main_curve[0]
    print(main_curve.IsClosed)
    #main_curve_coerced = rs.coercecurve(main_curve)
    main_curve.Domain = rc.Geometry.Interval(0,1)

    # need to make sure the main_curve is still oriented counter-clockwise around
    # the octagon. To do this we'll compare it's orientation to the orientation of 
    # subcurve2.
    p = subcurve2.PointAt(0)
    #p = rs.EvaluateCurve(subcurve2,0)

    t = main_curve.ClosestPoint(p)[1]
    #t = rs.CurveClosestPoint(main_curve,p)

    _ = main_curve.ChangeClosedCurveSeam(t)
    main_curve.Domain = rc.Geometry.Interval(0,1)
    #_ = rs.CurveSeam(Guid(main_curve),t)
    q = main_curve.LengthParameter(1)[1]

    q = rs.CurveArcLengthPoint(main_curve,1)
    p = rs.CurveArcLengthPoint(subcurve2,1)
    if not rs.PointCompare(p,q,tolerance=.01):
        _ = main_curve.Reverse()
        main_curve.Domain = rc.Geometry.Interval(0,1)
        print('x',main_curve.Domain)
    """Reevaluate main_curve here?"""
    #rs.JoinCurves

#rs.AddInterpCurve(points, degree=3, knotstyle=0, start_tangent=None, end_tangent=None)
#rs.BrepClosestPoint(object_id, point)

#interp_pts = interp_pts[int(iterate_to_show)]
#main_curves = main_curves[int(iterate_to_show)]

for i in range(len(newcurves)):
    if flipped[i]:
        _ = newcurves[i].Reverse()
        

newcurves = [newcurves[perm[i]] for i in range(len(newcurves))]
# ---------- end python_4 ----------
multiplication = Multiplication(A=number_slider, B=2)
addition = Addition(A=multiplication, B=1)
crv_7 = Curve(construct_master_curve.crv_10)
mypreview = RGBPreview(G=sph_2, A=opacity, N=color)
item = ListItem(List=pt, Index=[multiplication, addition], Wrap=True)
mypreview_2 = RGBPreview(G=sph, A=opacity_3, N=color_3)
mypreview_3 = RGBPreview(G=crv_5, A=opacity_2, N=color_2)
mypreview_4 = RGBPreview(G=construct_master_curve.geo_3, A=opacity_4, N=color_4)
mypreview_5 = RGBPreview(G=crv_4, A=opacity_5, N=color_5)
mypreview_6 = RGBPreview(G=crv_3, A=opacity_6, N=color_6)
crv_8 = Curve(reparameterize(python_4.newcurves))
item_2 = ListItem(List=crv_8, Index=number_slider, Wrap=True)
crv_9 = Curve(python_4.main_curve)
crv_10 = Curve(python_4.main_curves)
pt_2 = Point(python_4.interp_pts)
panel_11 = Panel(python_4.newcurves)
len = Length(Curve=crv_8)
int = Integer(len)
eval_3 = EvaluateCurve(Curve=reparameterize(item_2), Parameter=Slider(0.999, range=0..1))  # -> Point, Tangent, Angle
multiplication_2 = Multiplication(A=int, B=Slider(3, range=0..10))
panel_12 = Panel(python_4.out)
divide = DivideCurve(Curve=crv_8, Count=multiplication_2, Kinks=False)  # -> flatten(Points), Tangents, Parameters
intcrv = Interpolate(Vertices=divide.Points, Degree=3, Periodic=True, KnotStyle=1)  # -> Curve, Length, Domain
sort_points_by_push_order = GhPythonScript(curve=construct_master_curve.crv_10, pairedPointsList=abstract_points_to_rhino3dpoints.pairedPushPoints3D)  # -> out, sortedPointPairs; disabled
# ---------- sort_points_by_push_order: Python ----------
"""Provides a scripting component.
    Inputs:
        pairedPointsList: Collection of pairs of Rhino points
        curve: Master curve to put points on (for grabbing params)
            Must be parametrized on [0,1]
    Output:
        a: The list of pairs of 3dRhinoPoints sorted in the order they should be
            applied to the master curve."""

__author__ = "Shoon"
__version__ = "2021.02.26"

import rhinoscriptsyntax as rs
"The order of pairing:"
"List all possible ways of connection and categorize them by degree."
"Those with lower order are always connected first."
"For multiple curves that have the same degree, we deal with those that connect"
"the same two edges first."
"Based on the connection's orientation (0 or 1), we find an order that also depends on the points' coordinates."
"The pairs of connection are always written in the (smaller, larger) order."
"The key is the pair and the value is the connection's type."
deg1 = {(6,7):0, (6,8):1, (~6,7):0, (~6,1):1, (~8,1):0, (~8,~1):1, (~7,~1):0, (~7,8):1}
deg2 = {(7,8):1, (1,7):1, (~8,~6):0, (~8,~7):1, (~1,8):1, (~7,6):1}
deg3 = {(~6,8):0, (1,6):1, (~8,7):0, (~6,~1):1, (~7,1):0, (~1,6):1}
deg4 = {(1,8):0, (~8,6):1, (~1,7):1, (~7,~6):0}

#Need to convert this to Grasshopper edges instead of Flipper edges.

def reorder_a_pair(pair):
    if pair[1] < pair[0]:
        return (pair[1], pair[0])
    else:
        return pair

def getpair(connection):
    #A connection is in this form: ((edge1, index1),(edge2, index2))
    #Get the pair fo connection and also reorder it.
    return reorder_a_pair((connection[0][0], connection[1][0]))
    
def compare_index(connection1, connection2):
    #Return the one with the smaller index.
    if connection1[0][0] < connection1[1][0]:
        if connection2[0][0] < connection2[1][0]:
            if connection1[0][1] < connection2[0][1]:
                return connection1
            elif connection1[0][1] > connection2[0][1]:
                return connection2
        elif connection2[0][0] > connection2[1][0]:
            if connection1[0][1] < connection2[1][1]:
                return connection1
            elif connection1[0][1] > connection2[1][1]:
                return connection2
    elif connection1[0][0] > connection1[1][0]:
        if connection2[0][0] < connection2[1][0]:
            if connection1[1][1] < connection2[0][1]:
                return connection1
            elif connection1[1][1] > connection2[0][1]:
                return connection2
        elif connection2[0][0] > connection2[1][0]:
            if connection1[1][1] < connection2[1][1]:
                return connection1
            elif connection1[1][1] > connection2[1][1]:
                return connection2

def reorder_same_type(this_type, type):
    #This function reorders a list of connections of the same type, i. e. connecting the same pair of edges.
    print(type)
    if (type in deg1) == True:
        orientation = deg1[type]
    elif (type in deg2) == True:
        orientation = deg2[type]
    elif (type in deg3) == True:
        orientation = deg3[type]
    elif (type in deg4) == True:
        orientation = deg4[type]
    this_type_new = [this_type[0]]
    for connection in this_type[1:]:
        for i in range(0, len(this_type_new)):
            if orientation == 0:
                if compare_index(connection, this_type_new[i]) == connection:
                    this_type_new.insert(i, connection)
                    break
                elif compare_index(connection, this_type_new[i]) == this_type_new[i]:
                    if i == len(this_type_new)-1:
                        this_type_new.append(connection)
            elif orientation == 1:
                if compare_index(connection, this_type_new[i]) == this_type_new[i]:
                    this_type_new.insert(i, connection)
                    break
                elif compare_index(connection, this_type_new[i]) == connection:
                    if i == len(this_type_new)-1:
                        this_type_new.append(connection)
    return this_type_new
    
def reorder_same_degree(conn_list):
    #This function reorders a list of connections of the same degree.
    original_list = conn_list
    reorder_list = []
    while len(original_list) > 0:
        type = getpair(original_list[0])
        this_type = []
        for connection in original_list:
            if getpair(connection) == type:
                this_type.append(connection)
                original_list.remove(connection)
        reorder_list = reorder_list + reorder_same_type(this_type, type)
    return reorder_list

#It would be better if the input is the 'abstract point list,' i.e. [((point1),(point2)),...].
conn_deg1 = []
conn_deg2 = []
conn_deg3 = []
conn_deg4 = []

#Test
abstractPointList = [((~8,0), (1,0)), ((~1,0), (7,0)), ((~7,0), (6,0)), ((~6,0), (1,1)), ((~1,1), (7,1)), ((~7,1), (8,0))]

for connection in abstractPointList:
    if (getpair(connection) in deg1) == True:
        conn_deg1.append(connection)
    elif (getpair(connection) in deg2) == True:
        conn_deg2.append(connection)
    elif (getpair(connection) in deg3) == True:
        conn_deg3.append(connection)
    elif (getpair(connection) in deg4) == True:
        conn_deg4.append(connection)
sorted = reorder_same_degree(conn_deg1) + reorder_same_degree(conn_deg2) + reorder_same_degree(conn_deg3) + reorder_same_degree(conn_deg4)

print(sorted)
"Output should be [((edge1, index1), (edge2, index2)), ...] in the order of connection."
#sortedPointPairs = sorted(pairedPointsList, key = get_param_dist, reverse = True)
# ---------- end sort_points_by_push_order ----------
fully_push_curve = GhPythonScript(
    curve=construct_master_curve.crv_10,
    brep=construct_master_curve.geo_3,
    pointPairs=abstract_points_to_rhino3dpoints.pairedPushPoints3D)  # -> out, pushedCurveFragments; inputs pointPairs: list; disabled
# ---------- fully_push_curve: Python ----------
"""Provides a scripting component.
    Inputs:
        curve: Initial Master Curve, parametrized to [0,1]
        pointPairs: A list of pairs of points to use for pushing, in order
    Output:
        a: The a output variable"""

__author__ = "Shoon"
__version__ = "2021.02.26"

import rhinoscriptsyntax as rs
import Grasshopper as gh
import os

# Coerce inputs
curve = rs.coercecurve(curve)
brep = rs.coercebrep(brep)

# Set cluster path
par = os.path.abspath(os.path.join(os.path.dirname(ghenv.Component.OnPingDocument().FilePath)))
clusterFilePath = os.path.join(par, "PushCurvePart.ghcluster")


def iterate_push (doc, curve, dStart, dEnd):    
    cluster = gh.Kernel.Special.GH_Cluster()
    cluster.CreateFromFilePath(clusterFilePath)
    cluster.Params.Input[0].AddVolatileData(gh.Kernel.Data.GH_Path(0), 0, curve)
    cluster.Params.Input[1].AddVolatileData(gh.Kernel.Data.GH_Path(0), 0, dStart)
    cluster.Params.Input[2].AddVolatileData(gh.Kernel.Data.GH_Path(0), 0, dEnd)
    cluster.Params.Input[3].AddVolatileData(gh.Kernel.Data.GH_Path(0), 0, brep)
    a = gh.Kernel.Parameters.Param_Curve()
    b = gh.Kernel.Parameters.Param_Curve()
    
    cluster.Params.RegisterOutputParam(a)
    cluster.Params.RegisterOutputParam(b)
    doc.Enabled = True
    doc.AddObject(cluster, True, 0)
    pushedFrag = cluster.Params.Output[0].VolatileData
    newMasterCurve = cluster.Params.Output[0].VolatileData
    doc.Enabled = False
    doc.RemoveObject(cluster, False)
    return(a, b)

    
def main():
    # Get doc and set output vars
    doc = gh.Kernel.GH_Document()
    pushedCurveFragments = []
    masterCurve = curve
    
    for pair in [[0.5,0.6], [0.6,0.7]]:
        pair[0] = rs.EvaluateCurve(masterCurve, pair[0])
        pair[1] = rs.EvaluateCurve(masterCurve, pair[1])
        # Map 3-D points to parameters
        (pair0, pair1) = (rs.coerce3dpoint(pair[0]), rs.coerce3dpoint(pair[1]))
        (pair0, pair1) = (rs.CurveClosestPoint(masterCurve, pair0), rs.CurveClosestPoint(masterCurve, pair1))
        # Figure out how to do the start and end of the domains, espec if they go through 1
        # The logic for this might already be in the cluster, but I'm not sure.
        
        # push and get return values
        print(masterCurve, pair)
        (newFrag, masterCurve) = iterate_push(doc, masterCurve, pair[0], pair[1])
        pushedCurveFragments.append(newFrag)
        
    # destroy doc
    doc.Dispose()
    doc = None
        
    return(pushedCurveFragments)
    
pushedCurveFragments = main()
# ---------- end fully_push_curve ----------
sort_map_curves = GhPythonScript()  # -> out, mapCurveDict; disabled; unedited script template
partly_pushed_full_curve = PartlyPushedFullCurve(
    curve=construct_master_curve.crv_10,
    domain_start=Slider(0.593, range=0..1),
    domain_end=Slider(0.603, range=0..1),
    brep=construct_master_curve.geo_3)  # -> curve_4, curve_3
fully_push_curve_original_ver = GhPythonScript(
    curve=construct_master_curve.crv_10,
    brep=construct_master_curve.geo_3,
    pointPairs=sort_points_by_push_order.sortedPointPairs)  # -> out, pushedCurveFragments; inputs pointPairs: list; disabled; same code as fully_push_curve

# ==== cluster PartlyPushedFullCurve
curve = ClusterInput()
number = Number(0.0001)
number_2 = Number(0.01)
curve_2 = Curve(reparameterize(curve))
brep = ClusterInput()
domain_start = ClusterInput()
domain_end = ClusterInput()
construct_domain = ConstructDomain(DomainStart=domain_start, DomainEnd=domain_end)
sub_curve = SubCurve(BaseCurve=reparameterize(curve_2), Domain=construct_domain)
number_3 = Number(-30)
number_4 = Number(500)
curve_contraction_cluster = CurveContractionCluster(brep=brep, curve=sub_curve, steps=number_4, rightwards=number_3)  # -> curve_3, point
ghpython_script = GhPythonScript(
    start=domain_start,
    end=domain_end,
    step=number,
    separation=number_2,
    baseCurve=curve_2,
    pushedPoints=curve_contraction_cluster.point)  # -> out, points; inputs pushedPoints: list
# ---------- ghpython_script: Python ----------
__author__ = "Shoon"
__version__ = "2021.01.27"

import rhinoscriptsyntax as rs

points = []

def frange(a,b,s):
    x = float(a)
    while x < b:
        yield x
        x+=s


[points.append(rs.EvaluateCurve(baseCurve,i)) for i in frange(max(0,end+separation-1),max(0,end+separation-1,start-separation),step)]

points += rs.coerce3dpointlist(pushedPoints)

[points.append(rs.EvaluateCurve(baseCurve,i)) for i in frange(min(end+separation,1,1+start-separation),min(1+start-separation,1),step)]
# ---------- end ghpython_script ----------
interpolate_t = InterpolateT(Vertices=ghpython_script.points, TangentStart=Vector(0, 0, 0), TangentEnd=Vector(0, 0, 0), KnotStyle=1)  # -> Curve, Length, Domain
curve_3 = ClusterOutput(interpolate_t.Curve)
curve_4 = ClusterOutput(curve_contraction_cluster.curve_3)

# ==== cluster RGBPreview: Custom Preview clustered with RGB module with preset colors
N = ClusterInput()
python = GhPythonScript(N=N)  # -> out, R, G, B
# ---------- python: Python ----------
__author__ = "will"
__version__ = "2020.07.20"

import rhinoscriptsyntax as rs

colors=[(0,0,0),(255,255,255),(115,115,115),(255,0,0),(0,255,0),(0,0,255),(255,255,0),(255,0,255),(0,255,255),(0,162,255),(252,124,21),(124,51,202),(23,151,59),(255,80,90),(255,80,226),(32,214,255),(0,92,0),(0,0,120),(112,255,49),(138,78,0)]

N=int(N)
R = colors[N][0]
G = colors[N][1]
B = colors[N][2]
# ---------- end python ----------
A = ClusterInput()
G = ClusterInput()
rgb = ColourRGB(Alpha=A, Red=python.R, Green=python.G, Blue=python.B)
preview = CustomPreview(Geometry=G, Material=rgb)

# ==== cluster Genus2Surface
number_slider = Slider(4, range=0..16)
wide = ClusterInput()
multiplication = Multiplication(A=number_slider, B=2)
long = ClusterInput()
round = ClusterInput()
thick = ClusterInput()
subtraction = Subtraction(A=number_slider, B=1)
taper = ClusterInput()
pt = ConstructPoint(XCoordinate=Slider(0.5, range=0..1), YCoordinate=Slider(0.403, range=0..1), ZCoordinate=0)

# ----
# wonky tori
number_slider_2 = Slider(16.8, range=0..20)
addition = Addition(A=number_slider_2, Wide=wide)
dom = ConstructDomain(DomainStart=0, DomainEnd=1)
ellipse = Ellipse(Plane=PlaneXY(0, 0, 0), Radius1=number_slider_2, Radius2=addition)  # -> reparameterize(Ellipse), Focus1, Focus2
range = Range(Domain=dom, Steps=multiplication)
num = Number(range)
curvature = Curvature(Curve=ellipse.Ellipse, Parameter=num)  # -> P, unitize(K), C
python = GhPythonScript(x=num, long=long, round=round, thick=thick)  # -> out, a, b, c
# ---------- python: Python ----------
__author__ = "will"
__version__ = "2020.07.08"

import rhinoscriptsyntax as rs

a = ((x-.5)*long)**6

b = ((x-.5)*round)**2 + thick

c = a + thick
# ---------- end python ----------
rev = Reverse(Vector=curvature.K)
multiplication_2 = Multiplication(A=rev, B=python.a)
number_slider_3 = Slider(12, range=0..30)
addition_2 = Addition(A=multiplication_2, B=curvature.P)
Z = UnitZ(Factor=1)
dom_2 = ConstructDomain(DomainStart=0, DomainEnd=1)
pl = ConstructPlane(Origin=addition_2, XAxis=Z, YAxis=curvature.K)
range_2 = Range(Domain=dom_2, Steps=number_slider_3)
ellipse_2 = Ellipse(Plane=pl, Radius1=python.b, Radius2=python.c)  # -> reparameterize(Ellipse), Focus1, Focus2
split = SplitList(List=range_2, Index=number_slider_3)  # -> graft(ListA), ListB
item = ListItem(List=addition_2, Index=0, Wrap=True)
eval = EvaluateCurve(Curve=ellipse_2.Ellipse, Parameter=split.ListA)  # -> Point, Tangent, Angle
split_2 = SplitList(List=ellipse_2.Ellipse, Index=1)  # -> ListA, ListB
yz = YZPlane(Origin=Point(0, 0, 0))
intcrv = Interpolate(Vertices=eval.Point, Degree=3, Periodic=True, KnotStyle=1)  # -> flatten(Curve), Length, Domain
pl_origin = PlaneOrigin(Base=yz, Origin=item)
number_slider_4 = Slider(0.3, range=0..1)
addition_3 = Addition(A=number_slider_4, Taper=taper)

shift = ShiftList(List=split_2.ListB, Shift=subtraction, Wrap=True)

netsurf = NetworkSurface(CurvesU=shift, CurvesV=intcrv.Curve, Continuity=2)
mirror = Mirror(Geometry=netsurf, Plane=pl_origin)  # -> Geometry, Transform
join = BrepJoin(Breps=[mirror.Geometry, netsurf])  # -> Breps, Closed
taper_2 = Taper(
    Geometry=join.Breps,
    Axis=Line((-30, 0, 0), (80, 0, 0)),
    Start=number_slider_4,
    End=addition_3,
    Flat=False,
    Infinite=False,
    Rigid=False)
item_2 = ListItem(List=taper_2, Index=1, Wrap=True)
item_3 = ListItem(List=taper_2, Index=0, Wrap=True)

# ----
# Waist
hilonums = HighestLowestNumbers(Numbers=python.c)  # -> Highest, Lowest
number_slider_5 = Slider(7.305, range=0..10)
number_slider_6 = Slider(3.563, range=0..4)
number_slider_7 = Slider(2.366, range=0..4)
multiplication_3 = Multiplication(A=hilonums.Highest, B=2)
neg = Negative(Value=number_slider_7)
neg_2 = Negative(Value=number_slider_6)
neg_3 = Negative(Value=number_slider_5)
division = Division(A=hilonums.Highest, B=[neg_3, neg_2, neg])
division_2 = Division(A=hilonums.Highest, B=[number_slider_7, number_slider_6, number_slider_5])
X = UnitX(Factor=division_2)
X_2 = UnitX(Factor=division)
bbox = BoundingBox(Content=taper_2, Plane=PlaneXY(0, 0, 0), UnionBox=True)  # -> Box, Box_2
move = Move(Geometry=pl_origin, Motion=X)  # -> Geometry, Transform
move_2 = Move(Geometry=pl_origin, Motion=X_2)  # -> Geometry, Transform
box_corners = BoxCorners(Box=bbox.Box)  # -> CornerA, CornerB, CornerC, CornerD, CornerE, CornerF, CornerG, CornerH
pdecon = Deconstruct(Point=box_corners.CornerA)  # -> XComponent, YComponent, ZComponent
neg_4 = Negative(Value=pdecon.YComponent)
dom_3 = ConstructDomain(DomainStart=neg_4, DomainEnd=pdecon.YComponent)
planesrf = PlaneSurface(Plane=move_2.Geometry, XSize=dom_3, YSize=dom_3)
planesrf_2 = PlaneSurface(Plane=move.Geometry, XSize=dom_3, YSize=dom_3)
bbx = BrepBrep(BrepA=planesrf, BrepB=item_2)  # -> flatten(Curves), Points
bbx_2 = BrepBrep(BrepA=planesrf_2, BrepB=item_3)  # -> flatten(Curves), Points
crv = Curve([bbx_2.Curves, bbx.Curves])
loft = Loft(Curves=flatten(crv), Options={Adjust=True, Closed=False, LoftEnds=0, LoftSimp=0, LoftType=1, Rebuild=10, Refit=0.01})

# ----
# Trimmed wonky tori
item_4 = ListItem(List=planesrf, Index=-1, Wrap=True)
item_5 = ListItem(List=planesrf_2, Index=0, Wrap=True)
X_3 = UnitX(Factor=multiplication_3)
neg_5 = Negative(Value=X_3)
extr = Extrude(Base=item_5, Direction=neg_5)
extr_2 = Extrude(Base=item_4, Direction=X_3)
trim = TrimSolid(Shape=item_2, Cutters=extr_2)
trim_2 = TrimSolid(Shape=item_3, Cutters=extr)

evalsrf = EvaluateSurface(Surface=reparameterize(loft), Point=pt)  # -> Point, Normal, UDirection, VDirection, Frame
L = ClusterOutput(loft)
pl_2 = PlaneNormal(Origin=evalsrf.Point, ZAxis=evalsrf.Normal)
join_2 = BrepJoin(Breps=flatten([trim, loft, trim_2]))  # -> Breps, Closed
P = ClusterOutput(pl_2)
geo = Geometry(join_2.Breps)
geo_2 = ClusterOutput(geo)

# ==== cluster Cluster
steps = ClusterInput()
curve = ClusterInput()
range = Range(Domain=Domain(0, 1), Steps=steps)
evaluate_curve = EvaluateCurve(Curve=reparameterize(graft(curve)), Parameter=range)  # -> Point, Tangent, Angle
brep = ClusterInput()
brep_closest_point = BrepClosestPoint(Point=evaluate_curve.Point, Brep=brep)  # -> Point, Normal, Distance
interpolate = Interpolate(Vertices=brep_closest_point.Point, Degree=3, Periodic=False, KnotStyle=1)  # -> Curve, Length, Domain
curve_2 = ClusterOutput(interpolate.Curve)

# ==== cluster ConstructMasterCurve
geo = ClusterInput()
P = ClusterInput()
crv = Curve(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)
crv_2 = Curve(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)
crv_3 = Curve(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)
crv_4 = Curve(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)
geo_2 = Geometry(geo)
crv_5 = Curve([crv, crv_2, crv_3, crv_4])
integer = Integer(500)
cir = Circle(Plane=P, Radius=Slider(10, range=0..10))
project_curves_onto_brep = ProjectCurvesOntoBrep(curve=crv_5, steps=integer, brep=geo_2)
project = Project(Curve=cir, Brep=geo_2, Direction=Vector(0, 0, 1))
item = ListItem(List=project, Index=0, Wrap=True)
curves_on_polysurface = Curve(reparameterize(project_curves_onto_brep))
epsilon = ClusterInput()
number = Number(1)
epsilon_2 = Number(epsilon)
cluster = Cluster_2(brep=geo_2, curve=curves_on_polysurface, rightwards=number, C=item, num=epsilon_2)  # -> full_curve_2, right_shifted_curves_2, original_curves_2, punct_curves
crv_6 = Curve(cluster.full_curve_2)
crv_7 = Curve(cluster.punct_curves)
crv_8 = Curve(cluster.right_shifted_curves_2)
crv_9 = Curve(cluster.original_curves_2)
geo_3 = ClusterOutput(geo_2)
crv_10 = ClusterOutput(crv_6)
crv_11 = ClusterOutput(crv_8)
crv_12 = ClusterOutput(crv_9)
crv_13 = ClusterOutput(crv_7)

# ==== cluster CurveContractionCluster
steps = ClusterInput()
brep = ClusterInput()
rightwards = ClusterInput()
curve = ClusterInput()
curve_2 = Curve(curve)
range = Range(Domain=Domain(0, 1), Steps=steps)
evaluate_curve = EvaluateCurve(Curve=reparameterize(curve_2), Parameter=range)  # -> Point, Tangent, Angle
brep_2 = Brep(brep)
brep_closest_point = BrepClosestPoint(Point=evaluate_curve.Point, Brep=brep_2)  # -> Point, Normal, Distance
script_1_tbd = GhPythonScript(x=evaluate_curve.Point, y=evaluate_curve.Tangent, z=brep_closest_point.Normal, Rightwards=rightwards)  # -> out, shiftedPoints
# ---------- script_1_tbd: Python ----------
"""Provides a scripting component.
    Inputs:
        x: Points along Curve
        y: Vectors tangent to curve at each point
        z: Vectors normal to surface at each point
        inwards: 1 if you want to shift curve inwards, -1 if outwards
    Output:
        a: The a output variable"""

__author__ = "Shoon"
__version__ = "2020.11.04"

import rhinoscriptsyntax as rs

epsilon = 0.01

print(x)
print(y)
print(z)

# Compute the cross product of the above two vectors at each point
crosses = Rightwards * rs.VectorCrossProduct(z,y)

# Displace points along said cross product by some distance
shiftedPoints = rs.VectorAdd(x,epsilon*crosses)

# Copy points up by epsilon and down by epsilon to form a ribbon


# Take the intersection of the ribbon with the surface and draw it
# ---------- end script_1_tbd ----------
brep_closest_point_2 = BrepClosestPoint(Point=script_1_tbd.shiftedPoints, Brep=brep_2)  # -> Point, Normal, Distance
point = ClusterOutput(brep_closest_point_2.Point)
interpolate = Interpolate(Vertices=brep_closest_point_2.Point, Degree=3, Periodic=False, KnotStyle=1)  # -> Curve, Length, Domain
curve_3 = ClusterOutput(interpolate.Curve)

# ==== cluster ProjectCurvesOntoBrep
brep = ClusterInput()
steps = ClusterInput()
curve = ClusterInput()
range = Range(Domain=Domain(0, 1), Steps=steps)
evaluate_curve = EvaluateCurve(Curve=reparameterize(graft(curve)), Parameter=range)  # -> Point, Tangent, Angle
brep_closest_point = BrepClosestPoint(Point=evaluate_curve.Point, Brep=brep)  # -> Point, Normal, Distance
interpolate = Interpolate(Vertices=brep_closest_point.Point, Degree=3, Periodic=False, KnotStyle=1)  # -> Curve, Length, Domain
curve_2 = ClusterOutput(interpolate.Curve)

# ==== cluster Cluster_2
curve = ClusterInput()
curve_2 = Curve(curve)
num = ClusterInput()
range = Range(Domain=Domain(0, 1), Steps=1000)
brep = ClusterInput()
evaluate_curve = EvaluateCurve(Curve=reparameterize(curve_2), Parameter=range)  # -> Point, Tangent, Angle
brep_2 = Brep(brep)
C = ClusterInput()
brep_closest_point = BrepClosestPoint(Point=evaluate_curve.Point, Brep=brep_2)  # -> Point, Normal, Distance
pt = Point(evaluate_curve.Point)
crv_cp = CurveClosestPoint(Point=pt, Curve=C)  # -> Point, Parameter, Distance
dist = Distance(PointA=pt, PointB=crv_cp.Point)
num_2 = Number(num)
rightwards = ClusterInput()
script_1_tbd = GhPythonScript(
    x=evaluate_curve.Point,
    y=evaluate_curve.Tangent,
    z=brep_closest_point.Normal,
    Rightwards=rightwards,
    D=dist,
    epsilon=num_2)  # -> out, shiftedPoint, point
# ---------- script_1_tbd: Python ----------
"""Provides a scripting component.
    Inputs:
        x: Points along Curve
        y: Vectors tangent to curve at each point
        z: Vectors normal to surface at each point
        inwards: 1 if you want to shift curve inwards, -1 if outwards
    Output:
        a: The a output variable"""

__author__ = "Shoon"
__version__ = "2020.11.04"

import rhinoscriptsyntax as rs



print(x)
print(y)
print(z)

# Compute the cross product of the above two vectors at each point
crosses = Rightwards * rs.VectorCrossProduct(z,y)

# Displace points along said cross product by some distance

if D>=2:
    shiftedPoint = rs.VectorAdd(x,epsilon*crosses)
    point = x
else:
    shiftedPoint = rs.VectorAdd(x,((1/16)*(1/epsilon-1)*(D-2)**2+1)*epsilon*crosses)
    point = rs.VectorAdd(x,-((1/16)*(1/epsilon-1)*(D-2)**2)*epsilon*crosses)

# Copy points up by epsilon and down by epsilon to form a ribbon


# Take the intersection of the ribbon with the surface and draw it
# ---------- end script_1_tbd ----------
brep_closest_point_2 = BrepClosestPoint(Point=script_1_tbd.point, Brep=brep_2)  # -> Point, Normal, Distance
brep_closest_point_3 = BrepClosestPoint(Point=script_1_tbd.shiftedPoint, Brep=brep_2)  # -> Point, Normal, Distance
pt_2 = Point(reverse(brep_closest_point_3.Point))
interpolate = Interpolate(Vertices=brep_closest_point_3.Point, Degree=3, Periodic=False, KnotStyle=1)  # -> Curve, Length, Domain
pt_3 = Point(brep_closest_point_2.Point)
intcrv = Interpolate(Vertices=brep_closest_point_2.Point, Degree=3, Periodic=False, KnotStyle=1)  # -> Curve, Length, Domain
stack = StackTrees(Data0=pt_3, Data1=pt_2, Reduce=True)
panel = Panel("""0
7
1
6
5
4
2
3""")
flip = FlipMatrix(Data=stack)
item = ListItem(List=flip, Index=panel, Wrap=True)
flip_2 = FlipMatrix(Data=item)  # -> flatten(Data)
num_3 = Number(num_2)
intcrv_2 = Interpolate(Vertices=flip_2, Degree=3, Periodic=True, KnotStyle=1)  # -> Curve, Length, Domain
division = Division(A=intcrv_2.Length, B=num_3)
integer_division = IntegerDivision(A=division, B=1)
range_2 = Range(Domain=Domain(0, 1), Steps=integer_division)
evaluate_curve_2 = EvaluateCurve(Curve=reparameterize(intcrv_2.Curve), Parameter=range_2)  # -> Point, Tangent, Angle
right_shifted_curves = Curve(reparameterize(interpolate.Curve))
brep_closest_point_4 = BrepClosestPoint(Point=evaluate_curve_2.Point, Brep=brep_2)  # -> Point, Normal, Distance
original_curves = Curve(reparameterize(intcrv.Curve))
intcrv_3 = Interpolate(Vertices=brep_closest_point_4.Point, Degree=3, Periodic=True, KnotStyle=1)  # -> Curve, Length, Domain
end = EndPoints(Curve=original_curves)  # -> flatten(Start), flatten(End)
end_2 = EndPoints(Curve=right_shifted_curves)  # -> flatten(Start), flatten(End)
full_curve = Curve(reparameterize(intcrv_3.Curve))
panel_2 = Panel("""12
3
13
2
1
0
14
15""")
panel_3 = Panel("""7
9
6
5
4
10
11
8""")
pt_4 = Point([end_2.Start, end_2.End, end.Start, end.End])
item_2 = ListItem(List=pt_4, Index=panel_2, Wrap=True)
item_3 = ListItem(List=pt_4, Index=panel_3, Wrap=True)
crv_cp_2 = CurveClosestPoint(Point=item_2, Curve=full_curve)  # -> Point, Parameter, Distance
crv_cp_3 = CurveClosestPoint(Point=item_3, Curve=full_curve)  # -> Point, Parameter, Distance
python = GhPythonScript(t=crv_cp_3.Parameter)  # -> out, t
# ---------- python: Python ----------
__author__ = "will"
__version__ = "2021.04.03"

import rhinoscriptsyntax as rs

if t < .01:
    t = 1
# ---------- end python ----------
dom = ConstructDomain(DomainStart=crv_cp_2.Parameter, DomainEnd=python.t)
subcrv = SubCurve(BaseCurve=full_curve, Domain=dom)
punct_curves = ClusterOutput(subcrv)
full_curve_2 = ClusterOutput(full_curve)
right_shifted_curves_2 = ClusterOutput(right_shifted_curves)
original_curves_2 = ClusterOutput(original_curves)
